# Grasshopper definition pillar_morphology_02.gh (Grasshopper 0.9.76)
# plug-ins: LunchBox, Weaverbird, Starling

oriz_ref_1 = Slider(41.356, range=3..100)
oriz_ref_2 = Slider(45.285, range=3..100)
material_thickness = Slider(6.7, range=0..20)
slot_lenght = Slider(20, range=3..20)

kerf_or_tollerance = Slider(0.1, range=0..0.3)
list = ValueList({"Material 1": 1, "Material 2": 1.1, "Material 3": 1.2, "Material 4": 1.3, "Material 5": 1.4, "Material 6": 1.5}, selected="Material 1")

half_width = Slider(30, range=0..50)

base_radius = Slider(1.25, range=1.15..1.5)
magnets_radius = Panel("1.5")
list_2 = ValueList({"pz 1": 0, "pz 2": 1, "pz 3": 2, "pz 4": 3, "circular base": 4, "ALL NESTED": 5}, selected="ALL NESTED")
xz = XZPlane(Origin=Point(0, 0, 0))
line = Line(Line((0, 0, 0), (0, 0, 100)))
platododec = PlatonicDodecahedron(Plane=PlaneXY(0, 0, 0), Radius=10)
debrep = DeconstructBrep(Brep=platododec)  # -> Faces, Edges, Vertices
platoocta = PlatonicOctahedron(Plane=PlaneXY(0, 0, 0), Radius=10, Truncation=0)
facen = FaceNormals(Mesh=debrep.Faces)  # -> graft(Centers), Normals
series = Series(Start=0, Step=3, Count=36)
panel = Panel("""0
2
3
4
8
9""")
panel_2 = Panel("""1
5
6
7
10
11""")
Y = UnitY(Factor=Slider(100, range=0..100))
item = ListItem(List=debrep.Faces, Index=panel, Wrap=True)
item_2 = ListItem(List=debrep.Faces, Index=panel_2, Wrap=True)
move = Move(Geometry=platoocta, Motion=Y)  # -> Geometry, Transform
mesh = MeshBrep(
    Brep=item,
    Settings={GridMaxCount=0, GridMinCount=16, JaggedSeams=False, MaxEdgeLength=0, MinEdgeLength=0.0001, MinTolerance=0, Refine=True, RefineAngle=0, RelativeTolerance=0.65, SimplePlanes=True, Tolerance=0})
mesh_2 = MeshBrep(
    Brep=item_2,
    Settings={GridMaxCount=0, GridMinCount=16, JaggedSeams=False, MaxEdgeLength=0, MinEdgeLength=0.0001, MinTolerance=0, Refine=True, RefineAngle=0, RelativeTolerance=0.65, SimplePlanes=True, Tolerance=0})
item_3 = ListItem(List=facen.Centers, Index=Slider(0, range=0..35), Wrap=True)
item_4 = ListItem(List=facen.Normals, Index=series, Wrap=True)
neg = Negative(Value=Slider(2.02, range=1..2.5))
wbthicken = WeaverbirdsMeshThicken(Distance=5, OffsetType=0)
vec = VectorXYZ(XComponent=0, YComponent=0, ZComponent="-70")  # -> Vector, Length
wbthicken_2 = WeaverbirdsMeshThicken(MeshCurves=mesh_2, Distance=neg, OffsetType=0)
wbthicken_3 = WeaverbirdsMeshThicken(MeshCurves=mesh, Distance=neg, OffsetType=0)
xz_2 = XZPlane(Origin=vec.Vector)
subtraction = Subtraction(A=half_width, B="10")
munion = MeshUnion(Meshes=wbthicken_2)
munion_2 = MeshUnion(Meshes=wbthicken_3)
polygon = Polygon(Plane=xz_2, Radius=subtraction, Segments=6, FilletRadius=0)  # -> Polygon, Length
debrep_2 = DeconstructBrep(Brep=polygon.Polygon)  # -> Faces, Edges, Vertices
points = PointList(Points=debrep_2.Vertices, Size=8)
item_5 = ListItem(List=debrep_2.Vertices, Index=[0, 3], Wrap=True)
item_6 = ListItem(List=debrep_2.Vertices, Index=[4, 2], Wrap=True)
item_7 = ListItem(List=debrep_2.Vertices, Index=[5, 1], Wrap=True)
split = SplitList(List=item_5, Index=1)  # -> ListA, ListB
split_2 = SplitList(List=item_6, Index=1)  # -> ListA, ListB
split_3 = SplitList(List=item_7, Index=1)  # -> ListA, ListB
ln = Line(StartPoint=split.ListA, EndPoint=split.ListB)
ln_2 = Line(StartPoint=split_2.ListA, EndPoint=split_2.ListB)
ln_3 = Line(StartPoint=split_3.ListA, EndPoint=split_3.ListB)
ccx = CurveCurve(CurveA=ln, CurveB=ln_2)  # -> Points, ParamsA, ParamsB
ccx_2 = CurveCurve(CurveA=ln, CurveB=ln_3)  # -> Points, ParamsA, ParamsB
vec_2 = VectorXYZ(XComponent=half_width, YComponent="0", ZComponent="0")  # -> Vector, Length
vec_3 = VectorXYZ(XComponent=half_width, YComponent="0", ZComponent="0")  # -> Vector, Length
dist = Distance(PointA=ccx.Points, PointB=ccx_2.Points)
vec_4 = VectorXYZ(XComponent=half_width, YComponent="0", ZComponent="0")  # -> Vector, Length
curvepoint = PointOnCurve(ln, parameter=0.5)
subtraction_2 = Subtraction(A="100", B=oriz_ref_2)
division = Division(A=dist, B="2")
X = UnitX(Factor=division)
subtraction_3 = Subtraction(A="100", B=oriz_ref_1)
end = EndPoints(Curve=line)  # -> Start, End
end_2 = EndPoints(Curve=line)  # -> Start, End
vec_5 = VectorXYZ(XComponent=half_width, YComponent="0", ZComponent="0")  # -> Vector, Length
end_3 = EndPoints(Curve=line)  # -> Start, End
move_2 = Move(Geometry=line, Motion=X)  # -> Geometry, Transform
ln_4 = Line(StartPoint=end.End, EndPoint=vec_2.Vector)
ln_5 = Line(StartPoint=end_2.End, EndPoint=vec_3.Vector)
division_2 = Division(A=slot_lenght, B="2")
division_3 = Division(A=slot_lenght, B="2")
neg_2 = Negative(Value=material_thickness)
division_4 = Division(A=material_thickness, B="2")
neg_3 = Negative(Value=material_thickness)
neg_4 = Negative(Value=material_thickness)
neg_5 = Negative(Value=subtraction_3)
division_5 = Division(A=material_thickness, B="2")
ln_6 = Line(StartPoint=end_3.End, EndPoint=vec_4.Vector)
division_6 = Division(A=slot_lenght, B="2")
neg_6 = Negative(Value=material_thickness)
division_7 = Division(A=material_thickness, B="2")
neg_7 = Negative(Value=material_thickness)
division_8 = Division(A=material_thickness, B="2")
neg_8 = Negative(Value=oriz_ref_2)
end_4 = EndPoints(Curve=move_2.Geometry)  # -> Start, End
end_5 = EndPoints(Curve=line)  # -> Start, End
dom = ConstructDomain(DomainStart=0, DomainEnd=material_thickness)
dom_2 = ConstructDomain(DomainStart=0, DomainEnd=slot_lenght)
end_6 = EndPoints(Curve=ln_4)  # -> Start, End
end_7 = EndPoints(Curve=ln_5)  # -> Start, End
dom_3 = ConstructDomain(DomainStart=0, DomainEnd=neg_3)
dom_4 = ConstructDomain(DomainStart=0, DomainEnd=division_2)
dom_5 = ConstructDomain(DomainStart=0, DomainEnd=neg_5)
dom_6 = ConstructDomain(DomainStart=0, DomainEnd=division_4)
dom_7 = ConstructDomain(DomainStart=0, DomainEnd=neg_4)
dom_8 = ConstructDomain(DomainStart=0, DomainEnd=division_3)
dom_9 = ConstructDomain(DomainStart=neg_2, DomainEnd=subtraction_2)
dom_10 = ConstructDomain(DomainStart=0, DomainEnd=division_5)
pt = Point(end.Start)
pt_2 = Point(end.End)
pt_3 = Point(end_2.Start)
pt_4 = Point(end_2.Start)
end_8 = EndPoints(Curve=ln_6)  # -> Start, End
dom_11 = ConstructDomain(DomainStart=0, DomainEnd=neg_7)
dom_12 = ConstructDomain(DomainStart=0, DomainEnd=division_6)
dom_13 = ConstructDomain(DomainStart=neg_6, DomainEnd=oriz_ref_1)
dom_14 = ConstructDomain(DomainStart=0, DomainEnd=division_7)
dom_15 = ConstructDomain(DomainStart=0, DomainEnd=neg_8)
dom_16 = ConstructDomain(DomainStart=0, DomainEnd=division_8)
xz_3 = XZPlane(Origin=end_4.End)
pt_5 = Point(end_3.Start)
pt_6 = Point(end_3.Start)
ln_7 = Line(StartPoint=end_5.End, EndPoint=vec_5.Vector)
pt_7 = Point(end_4.End)
pt_8 = Point(Point(-100, 0, 0))
division_9 = Division(A=material_thickness, B="2")
pl_origin = PlaneOrigin(Base=xz, Origin=pt)
pl_origin_2 = PlaneOrigin(Base=xz, Origin=pt_3)
division_10 = Division(A=slot_lenght, B="2")
pl_origin_3 = PlaneOrigin(Base=xz, Origin=pt_2)
pl_origin_4 = PlaneOrigin(Base=xz, Origin=pt_4)
pl_origin_5 = PlaneOrigin(Base=xz, Origin=pt_5)
pl_origin_6 = PlaneOrigin(Base=xz, Origin=pt_6)
pl_origin_7 = PlaneOrigin(Base=xz_3, Origin=pt_7)
end_9 = EndPoints(Curve=ln_7)  # -> Start, End
pl_origin_8 = PlaneOrigin(Base=xz, Origin=pt_8)
Z = UnitZ(Factor=division_9)
X_2 = UnitX(Factor=division_10)
rec_3pt = Rectangle3Pt(PointA=end_6.Start, PointB=end.Start, PointC=end_6.End)  # -> Rectangle, Length
rectangle = Rectangle(Plane=pl_origin, XSize=dom_4, YSize=dom_3, Radius=0)  # -> Rectangle, Length
rectangle_2 = Rectangle(Plane=pl_origin_3, XSize=dom_6, YSize=dom_5, Radius=0)  # -> Rectangle, Length
rec_3pt_2 = Rectangle3Pt(PointA=end_7.Start, PointB=end_2.Start, PointC=end_7.End)  # -> Rectangle, Length
rectangle_3 = Rectangle(Plane=pl_origin_2, XSize=dom_8, YSize=dom_7, Radius=0)  # -> Rectangle, Length
rectangle_4 = Rectangle(Plane=pl_origin_4, XSize=dom_10, YSize=dom_9, Radius=0)  # -> Rectangle, Length
rec_3pt_3 = Rectangle3Pt(PointA=end_8.Start, PointB=end_3.Start, PointC=end_8.End)  # -> Rectangle, Length
rectangle_5 = Rectangle(Plane=pl_origin_5, XSize=dom_12, YSize=dom_11, Radius=0)  # -> Rectangle, Length
rectangle_6 = Rectangle(Plane=pl_origin_6, XSize=dom_14, YSize=dom_13, Radius=0)  # -> Rectangle, Length
rectangle_7 = Rectangle(Plane=pl_origin_7, XSize=dom_16, YSize=dom_15, Radius=0)  # -> Rectangle, Length
move_3 = Move(Geometry=curvepoint, Motion=Z)  # -> Geometry, Transform
move_4 = Move(Geometry=curvepoint, Motion=X_2)  # -> Geometry, Transform
rectangle_8 = Rectangle(Plane=pl_origin_8, XSize=dom_2, YSize=dom, Radius=0)  # -> Rectangle, Length
rec_3pt_4 = Rectangle3Pt(PointA=end_9.Start, PointB=end_5.Start, PointC=end_9.End)  # -> Rectangle, Length
mirror = Mirror(Geometry=rec_3pt_4.Rectangle, Plane=PlaneYZ(0, 0, 0))  # -> Geometry, Transform
mirror_2 = Mirror(Geometry=rectangle_2.Rectangle, Plane=PlaneYZ(0, 0, 0))  # -> Geometry, Transform
mirror_3 = Mirror(Geometry=rectangle_4.Rectangle, Plane=PlaneYZ(0, 0, 0))  # -> Geometry, Transform
yz = YZPlane(Origin=Point(0, 0, 0))
mirror_4 = Mirror(Geometry=rec_3pt.Rectangle, Plane=PlaneYZ(0, 0, 0))  # -> Geometry, Transform
mirror_5 = Mirror(Geometry=rec_3pt_2.Rectangle, Plane=PlaneYZ(0, 0, 0))  # -> Geometry, Transform
mirror_6 = Mirror(Geometry=rectangle.Rectangle, Plane=PlaneYZ(0, 0, 0))  # -> Geometry, Transform
mirror_7 = Mirror(Geometry=rectangle_3.Rectangle, Plane=PlaneYZ(0, 0, 0))  # -> Geometry, Transform
pl_origin_9 = PlaneOrigin(Base=yz, Origin=pt_7)
rec_3pt_5 = Rectangle3Pt(PointA=curvepoint, PointB=move_3.Geometry, PointC=move_4.Geometry)  # -> Rectangle, Length
runion = RegionUnion(Curves=[rec_3pt_4.Rectangle, mirror.Geometry])
runion_2 = RegionUnion(Curves=[mirror_2.Geometry, rectangle_2.Rectangle])
runion_3 = RegionUnion(Curves=[mirror_3.Geometry, rectangle_4.Rectangle])
runion_4 = RegionUnion(Curves=[rec_3pt.Rectangle, mirror_4.Geometry])
runion_5 = RegionUnion(Curves=[rec_3pt_2.Rectangle, mirror_5.Geometry])
runion_6 = RegionUnion(Curves=[mirror_6.Geometry, rectangle.Rectangle])
runion_7 = RegionUnion(Curves=[mirror_7.Geometry, rectangle_3.Rectangle])
xy = XYPlane(Origin=Point(0, 0, 0))
mirror_8 = Mirror(Geometry=rec_3pt_3.Rectangle, Plane=PlaneYZ(0, 0, 0))  # -> Geometry, Transform
mirror_9 = Mirror(Geometry=rectangle_5.Rectangle, Plane=PlaneYZ(0, 0, 0))  # -> Geometry, Transform
mirror_10 = Mirror(Geometry=rectangle_6.Rectangle, Plane=PlaneYZ(0, 0, 0))  # -> Geometry, Transform
mirror_11 = Mirror(Geometry=rectangle_7.Rectangle, Plane=pl_origin_9)  # -> Geometry, Transform
mirror_12 = Mirror(Geometry=rec_3pt_5.Rectangle, Plane=PlaneYZ(0, 0, 0))  # -> Geometry, Transform
pl_origin_10 = PlaneOrigin(Base=xy, Origin=curvepoint)
mirror_13 = Mirror(Geometry=pl_origin_9, Plane=PlaneYZ(0, 0, 0))  # -> Geometry, Transform
mirror_14 = Mirror(Geometry=[mirror_12.Geometry, rec_3pt_5.Rectangle], Plane=pl_origin_10)  # -> Geometry, Transform
runion_8 = RegionUnion(Curves=[rec_3pt_3.Rectangle, mirror_8.Geometry])
runion_9 = RegionUnion(Curves=[mirror_9.Geometry, rectangle_5.Rectangle])
runion_10 = RegionUnion(Curves=[rec_3pt_5.Rectangle, mirror_12.Geometry, mirror_14.Geometry])
rad = Radians(Degrees=90)
runion_11 = RegionUnion(Curves=[mirror_10.Geometry, rectangle_6.Rectangle])
runion_12 = RegionUnion(Curves=[mirror_11.Geometry, rectangle_7.Rectangle])
vec2pt = Vector2Pt(PointA=curvepoint, PointB=ccx.Points, Unitize=False)  # -> Vector, Length
vec2pt_2 = Vector2Pt(PointA=curvepoint, PointB=ccx_2.Points, Unitize=False)  # -> Vector, Length
rotate = Rotate(Geometry=runion_10, Angle=rad, Plane=xz_2)  # -> Geometry, Transform

number_slider = Slider(0.442, range=0..0.5)
vec_6 = VectorXYZ(XComponent="-200", YComponent=0, ZComponent=0)  # -> Vector, Length
xz_4 = XZPlane(Origin=vec_6.Vector)
polygon_2 = Polygon(Plane=xz_4, Radius=Slider(7.519, range=0..30), Segments="3", FilletRadius=0)  # -> Polygon, Length
rotate_2 = Rotate(Geometry=polygon_2.Polygon, Angle=1.570796327, Plane=xz_4)  # -> Geometry, Transform
debrep_3 = DeconstructBrep(Brep=rotate_2.Geometry)  # -> Faces, graft(Edges), Vertices
item_8 = ListItem(List=debrep_3.Vertices, Index=0, Wrap=True)
curvepoint_2 = PointOnCurve(debrep_3.Edges, parameter=0.5)
rad_2 = Radians(Degrees="60")
pl_origin_11 = PlaneOrigin(Base=xz_4, Origin=item_8)
rotate_3 = Rotate(Geometry=rotate_2.Geometry, Angle=rad_2, Plane=pl_origin_11)  # -> Geometry, Transform
debrep_4 = DeconstructBrep(Brep=rotate_3.Geometry)  # -> Faces, graft(Edges), Vertices
bang = ExplodeTree(Data=curvepoint_2)  # -> Branch0, Branch1, Branch2
item_9 = ListItem(List=debrep_4.Vertices, Index=1, Wrap=True)
curvepoint_3 = PointOnCurve(debrep_4.Edges, parameter=0.5)
arc = Arc3Pt(PointA=bang.Branch1, PointB=bang.Branch2, PointC=bang.Branch0)  # -> Arc, Plane, Radius
bang_2 = ExplodeTree(Data=curvepoint_3)  # -> _0000, _0001, _0002
arc_2 = Arc3Pt(PointA=bang_2._0000, PointB=bang_2._0001, PointC=bang_2._0002)  # -> Arc, Plane, Radius
vec2pt_3 = Vector2Pt(PointA=item_8, PointB=item_9, Unitize=False)  # -> Vector, Length
arrlinear = LinearArray(Geometry=[arc.Arc, arc_2.Arc], Direction=vec2pt_3.Vector, Count=Slider(10, range=0..10))  # -> Geometry, Transform
arrcurve = CurveArray(Count=10)  # -> Geometry, Transform
join = JoinCurves(Curves=arrcurve.Geometry, Preserve=False)
join_2 = JoinCurves(Curves=arrlinear.Geometry, Preserve=False)
neg_9 = Negative(Value=number_slider)
offset = Offset(Curve=join_2, Distance=[number_slider, neg_9], Plane=PlaneXY(0, 0, 0), Corners=1)  # disabled

mirror_15 = Mirror(Geometry=runion_12, Plane=PlaneYZ(0, 0, 0))  # -> Geometry, Transform
pl_origin_12 = PlaneOrigin(Base=xz_2, Origin=debrep_2.Vertices)
cir = Circle(Plane=pl_origin_12, Radius=magnets_radius)
runion_13 = RegionUnion(Curves=[runion_10, rotate.Geometry])
move_5 = Move(Geometry=runion_13, Motion=vec2pt.Vector)  # -> Geometry, Transform
move_6 = Move(Geometry=runion_13, Motion=vec2pt_2.Vector)  # -> Geometry, Transform

subtraction_4 = Subtraction(A=slot_lenght, B=kerf_or_tollerance)  # disabled
division_11 = Division(A=subtraction_4, B=slot_lenght)
multiplication = Multiplication(A=division_11, B=list)
slot = Curve(runion_6)
pin = Curve(runion_2)
neg_10 = Negative(Value=multiplication)
scale_nu = ScaleNU(Geometry=slot, Plane=xz, ScaleX=multiplication, ScaleY=1, ScaleZ=1)  # -> Geometry, Transform
scale_nu_2 = ScaleNU(Geometry=pin, Plane=xz, ScaleX=neg_10, ScaleY=1, ScaleZ=1)  # -> Geometry, Transform

subtraction_5 = Subtraction(A=slot_lenght, B=kerf_or_tollerance)  # disabled
division_12 = Division(A=subtraction_5, B=slot_lenght)
multiplication_2 = Multiplication(A=division_12, B=list)
slot_2 = Curve(runion_7)
pin_2 = Curve(runion_3)
neg_11 = Negative(Value=multiplication_2)
scale_nu_3 = ScaleNU(Geometry=slot_2, Plane=xz, ScaleX=multiplication_2, ScaleY=1, ScaleZ=1)  # -> Geometry, Transform
scale_nu_4 = ScaleNU(Geometry=pin_2, Plane=xz, ScaleX=neg_11, ScaleY=1, ScaleZ=1)  # -> Geometry, Transform

subtraction_6 = Subtraction(A=slot_lenght, B=kerf_or_tollerance)  # disabled
division_13 = Division(A=subtraction_6, B=slot_lenght)
multiplication_3 = Multiplication(A=division_13, B=list)
slot_3 = Curve(runion_9)
pin_3 = Curve(runion_11)
pin_4 = Curve(mirror_15.Geometry)
pin_5 = Curve(runion_12)
neg_12 = Negative(Value=multiplication_3)
neg_13 = Negative(Value=multiplication_3)
neg_14 = Negative(Value=multiplication_3)
scale_nu_5 = ScaleNU(Geometry=slot_3, Plane=xz, ScaleX=multiplication_3, ScaleY=1, ScaleZ=1)  # -> Geometry, Transform
scale_nu_6 = ScaleNU(Geometry=pin_3, Plane=xz, ScaleX=neg_12, ScaleY=1, ScaleZ=1)  # -> Geometry, Transform
scale_nu_7 = ScaleNU(Geometry=pin_4, Plane=mirror_13.Geometry, ScaleX=neg_13, ScaleY=1, ScaleZ=1)  # -> Geometry, Transform
scale_nu_8 = ScaleNU(Geometry=pin_5, Plane=pl_origin_9, ScaleX=neg_14, ScaleY=1, ScaleZ=1)  # -> Geometry, Transform

multiplication_4 = Multiplication(A=kerf_or_tollerance, B=list)
multiplication_5 = Multiplication(A=subtraction, B=base_radius)
offset_2 = Offset(Curve=[cir, runion_13, move_5.Geometry, move_6.Geometry], Distance=multiplication_4, Plane=PlaneXY(0, 0, 0), Corners=1)
cir_2 = Circle(Plane=xz_2, Radius=multiplication_5)
runion_14 = RegionUnion(Curves=[runion_4, runion_6])
runion_15 = RegionUnion(Curves=[runion_5, runion_7])
runion_16 = RegionUnion(Curves=[runion_8, runion_9])
rdiff = RegionDifference(CurvesA=runion_14, CurvesB=runion_2)
rdiff_2 = RegionDifference(CurvesA=runion_15, CurvesB=runion_3)
rdiff_3 = RegionDifference(CurvesA=runion_16, CurvesB=[runion_11, runion_12, mirror_15.Geometry])
pillar_diameter = Slider(1, range=0.6..1)
sqeeze_factor = Slider(0.66, range=0.2..1)
pillar_height = Slider(76, range=10..120)
X_3 = UnitX(Factor="210")
X_4 = UnitX(Factor="0")
X_5 = UnitX(Factor="105")
X_6 = UnitX(Factor="315")
rotax = RotateAxis(Geometry=[cir_2, cir], Angle=1.570796327, Axis=ln)  # -> Geometry, Transform
move_7 = Move(Geometry=rdiff_2, Motion=X_3)  # -> Geometry, Transform
move_8 = Move(Geometry=rdiff, Motion=X_4)  # -> Geometry, Transform
move_9 = Move(Geometry=rdiff_2, Motion=X_5)  # -> Geometry, Transform
move_10 = Move(Geometry=rdiff_3, Motion=X_6)  # -> Geometry, Transform
multiplication_6 = Multiplication(A=multiplication_5, B=pillar_diameter)
pillar_radius = Panel(multiplication_6)
group = Group(Objects=[cir_2, offset_2])
division_14 = Division(A=pillar_height, B=2)
movetoplane = MoveToPlane(Geometry=rotax.Geometry, Plane=PlaneXY(0, 0, 0), Above=True, Below=True)  # -> flatten(Geometry), Transform
cir_3 = Circle(Plane=PlaneXY(0, 0, 0), Radius=multiplication_6)
Z_2 = UnitZ(Factor=[pillar_height, division_14])
split_4 = SplitList(List=movetoplane.Geometry, Index=1)  # -> ListA, ListB
sqrt = SquareRoot(Value="3")
move_11 = Move(Geometry=cir_3, Motion=Z_2)  # -> Geometry, Transform
vec_7 = VectorXYZ(XComponent=0, YComponent=0, ZComponent=Slider(2, range=0..3))  # -> Vector, Length
multiplication_7 = Multiplication(A=multiplication_5, B=sqrt)
vec_8 = VectorXYZ(XComponent=0, YComponent=0, ZComponent=division_14)  # -> Vector, Length
item_10 = ListItem(List=move_11.Geometry, Index=1, Wrap=True)
boundary = BoundarySurfaces(Edges=[split_4.ListA, split_4.ListB])
ln_8 = Line(StartPoint=Point(0, 0, 0), EndPoint=vec_7.Vector)

# ---- group: CENTER PILLAR
minimum_radius = Slider(3, range=2..5)
b_z_position = Slider(1, range=0..1)
a_tang = Slider(33.75, range=0..50)
b_tang = Slider(23.583, range=0..50)
multiplication_8 = Multiplication(A=b_z_position, B=pillar_height)
min = Minimum(A=b_tang, B=multiplication_6)
min_2 = Minimum(A=a_tang, B=multiplication_6)
division_15 = Division(A=multiplication_8, B=2)
Z_3 = UnitZ(Factor=min)
X_7 = UnitX(Factor=min_2)
rev = Reverse(Vector=Z_3)
end_10 = EndPoints(Curve=cir_3)  # -> Start, End
rev_2 = Reverse(Vector=X_7)
vec_9 = VectorXYZ(XComponent=minimum_radius, YComponent=0, ZComponent=division_15)  # -> Vector, Length
bzspan = BezierSpan(StartPoint=end_10.Start, StartTangent=rev_2, EndPoint=vec_9.Vector, EndTangent=rev)  # -> Curve, Length, Domain
revsrf = Revolution(Curve=bzspan.Curve, Axis=ln_8, Domain=Domain(0, 6.283185307))

# ----
Z_4 = UnitZ(Factor=division_14)
multiplication_9 = Multiplication(A=multiplication_7, B="2")
scale = Scale(Geometry=item_10, Center=vec_8.Vector, Factor=sqeeze_factor)  # -> Geometry, Transform
xy_2 = XYPlane(Origin=Z_4)
item_11 = ListItem(List=move_11.Geometry, Index=0, Wrap=True)
loft = Loft(
    Curves=[cir_3, scale.Geometry, item_11],
    Options={Adjust=False, Closed=False, LoftEnds=0, LoftSimp=0, LoftType=0, Rebuild=10, Refit=0.01})
multiplication_10 = Multiplication(A=multiplication_5, B="2")
Z_5 = UnitZ(Factor="30")
extr = Extrude(Base=split_4.ListB, Direction=Z_5)
scale_nu_9 = ScaleNU(Geometry=loft, Plane=xy_2, ScaleX=1, ScaleY=1, ScaleZ=Slider(1.128, range=1..1.2))  # -> Geometry, Transform
polygon_3 = Polygon(Plane=PlaneXY(0, 0, 0), Radius=multiplication_10, Segments=3, FilletRadius=0)  # -> Polygon, Length
trigrid = Triangular(Plane=PlaneXY(0, 0, 0), Size=multiplication_9, ExtentX="10", ExtentY="10")  # -> Cells, Points
rotax_2 = RotateAxis(Geometry=scale_nu_9.Geometry, Angle=Slider(0.082, range=0..0.5), Axis=ln_8)  # -> Geometry, Transform
rotate_4 = Rotate(Geometry=polygon_3.Polygon, Angle=1.570796327, Plane=PlaneXY(0, 0, 0))  # -> Geometry, Transform
pt_9 = Point(trigrid.Points)
number_slider_2 = Slider(6, range=3..100)
list_3 = ValueList({"0.05", "0.071", "0.080", "0.281", "0.291", "0.300"}, selected="0.291")

# ---- group: Top-Bottom plates
extrude = ExtrudeLinear(Profile=boundary, OrientationP=PlaneXY(0, 0, 0), Axis=ln_8)
mirror_16 = Mirror(Geometry=extrude, Plane=xy_2)  # -> Geometry, Transform

# ----
cap = CapHoles(Brep=extr)
filter = StreamFilter(
    Gate=list_2,
    Stream0=rdiff,
    Stream1=rdiff_2,
    Stream2=rdiff_2,
    Stream3=rdiff_3,
    Stream4=group,
    Stream5=[move_8.Geometry, move_9.Geometry, move_7.Geometry, move_10.Geometry, group])
debrep_5 = DeconstructBrep(Brep=rotate_4.Geometry)  # -> Faces, graft(Edges), Vertices
custom_mesh_settings = SettingsCustom(
    StitchSeams=True,
    SimplePlanes=False,
    Refine=True,
    MinCount=16,
    MaxCount=400,
    AspectRatio=20,
    MaxDistance=list_3,
    MaxAngle=20,
    MinEdge=0,
    MaxEdge=0)
len = Length(Curve=debrep_5.Edges)
end_11 = EndPoints(Curve=debrep_5.Edges)  # -> Start, End
mesh_uv = MeshSurface(Surface=rotax_2.Geometry, UCount=number_slider_2, VCount=number_slider_2, Overhang=True, Equalize=False)
slfastmesh = SlFastMesh(BReps=rotax_2.Geometry, EdgeLength=Slider(30.044, range=8..50))
mesh_3 = MeshBrep(Brep=rotax_2.Geometry, Settings=custom_mesh_settings)
vec_10 = VectorXYZ(XComponent=0, YComponent=0, ZComponent=Slider(1, range=1..2.5))  # -> Vector, Length
item_12 = ListItem(List=len, Index=0, Wrap=True)
vec2pt_4 = Vector2Pt(PointA=end_11.Start, PointB=end_11.End, Unitize=False)  # -> Vector, Length
mirror_17 = Mirror(Geometry=revsrf, Plane=xy_2)  # -> Geometry, Transform
mirror_18 = Mirror(Geometry=cap, Plane=xy_2)  # -> Geometry, Transform
ln_9 = Line(StartPoint=Point(0, 0, 0), EndPoint=vec_10.Vector)
list_4 = ValueList({"One": 0, "Two": 1, "Three": 2}, selected="Three")
number_slider_3 = Slider(1, range=1..3)
extrude_2 = ExtrudeLinear(Profile=rotate_4.Geometry, OrientationP=PlaneXY(0, 0, 0), Axis=ln_9)
filter_2 = StreamFilter(Gate=list_4, Stream0=mesh_uv, Stream1=slfastmesh, Stream2=mesh_3)
pl = PlaneNormal(Origin=end_11.Start, ZAxis=vec2pt_4.Vector)
vec2pt_5 = Vector2Pt(PointA=end_11.Start, PointB=end_11.End, Unitize=False)  # -> Vector, Length
join_3 = BrepJoin(Breps=[revsrf, mirror_17.Geometry])  # -> Breps, Closed
cap_2 = CapHoles(Brep=extrude_2)
cap_3 = CapHoles(Brep=join_3.Breps)

# ---- group: GAP1
division_16 = Division(A=item_12, B="4")
cyl = Cylinder(Base=pl, Radius="2", Length=division_16)
cap_4 = CapHoles(Brep=cyl)

# ----
sdiff = SolidDifference(BrepsA=cap_3, BrepsB=[mirror_18.Geometry, cap])
wbsplitquads = WeaverbirdsConstantQuadsSplitSubdivision(MeshCurves=filter_2, Level=number_slider_3, SmoothNakedEdges=1)
wbcatmullclark = WeaverbirdsCatmullClarkSubdivision(MeshCurves=filter_2, Level=number_slider_3, SmoothNakedEdges=1)
wbloop = WeaverbirdsLoopSubdivision(MeshCurves=filter_2, Level=number_slider_3, SmoothNakedEdges=1)
wbsierpinski = WeaverbirdsSierpinskiTrianglesSubdivision(MeshCurves=filter_2, Level=number_slider_3)
wbtriangles = WeaverbirdsSplitTrianglesSubdivision(MeshCurves=filter_2, Level=number_slider_3)
wbmidedge = WeaverbirdsMidedgeSubdivision(MeshCurves=filter_2, Level=number_slider_3, SmoothNakedEdges=1)
wbsplitpolygons = WeaverbirdsSplitPolygonsSubdivision(MeshCurves=filter_2, Level=number_slider_3, SmoothNakedEdges=1)

# ---- group: OUTER HINGE
cyl_2 = Cylinder(Base=pl, Radius="2", Length=item_12)
cap_5 = CapHoles(Brep=cyl_2)

# ---- group: INNER HINGE
cyl_3 = Cylinder(Base=pl, Radius="1", Length=item_12)
cap_6 = CapHoles(Brep=cyl_3)

# ---- group: GAP1 / TOLLERANCE
cyl_4 = Cylinder(Base=pl, Radius="2", Length="-0.5")
cap_7 = CapHoles(Brep=cyl_4)

# ----
list_5 = ValueList({"0", "1", "2", "3", "4", "5", "6", "7"}, selected="6")
filter_3 = StreamFilter(
    Gate=list_5,
    Stream0=wbsplitquads,
    Stream1=wbcatmullclark,
    Stream2=wbloop,
    Stream3=wbsierpinski,
    Stream4=wbtriangles,
    Stream5=wbmidedge,
    Stream6=wbsplitpolygons)
multiplication_11 = Multiplication(A=division_16, B="2")
wbdual = WeaverbirdsDualGraph(MeshCurves=filter_3, DualMode=1)

# ---- group: TUBE
sdiff_2 = SolidDifference(BrepsA=cap_5, BrepsB=cap_6)

# ----
amp = Amplitude(Vector=vec2pt_5.Vector, Amplitude=multiplication_11)

# ---- group: FACE
triangular_face = SolidDifference(BrepsA=cap_2, BrepsB=cap_6)

# ----
move_12 = Move(Geometry=cyl, Motion=amp)  # -> Geometry, Transform
explode = Explode(Curve=wbdual, Recursive=True)  # -> graft(Segments), Vertices
sdiff_3 = SolidDifference(BrepsA=sdiff_2, BrepsB=[cap_4, move_12.Geometry])
pipe = Pipe(Curve=explode.Segments, Radius=Slider(1, range=1..2), Caps=2)
group_2 = Group(Objects=[extrude, mirror_16.Geometry, pipe, sdiff])
