# Grasshopper definition planet_v1.gh (Grasshopper 0.9.76)
# plug-ins: Weaverbird

height = Slider(5, range=5..10)
number_slider = Slider(8, range=3..10)
Z = UnitZ(Factor=1)
number_slider_2 = Slider(5, range=0..5)
amp = Amplitude(Vector=Z, Amplitude=height)
pt = Point(Point(0, 0, 0))
move = Move(Geometry=pt, Motion=amp)  # -> Geometry, Transform
wbicosahedron = WeaverbirdsMeshMeshIcosahedron(Plane=PlaneXY(0, 0, 0), Radius=number_slider_2)
wbdipyramid = WeaverbirdsMeshDipyramid(
    Plane=PlaneXY(0, 0, 0),
    Width=number_slider_2,
    NumberOfSides=number_slider,
    TopPoint=move.Geometry,
    BasePolygonMethod=True)
wbantiprism = WeaverbirdsMeshAntiprism(
    Plane=PlaneXY(0, 0, 0),
    Width=number_slider_2,
    NumberOfSides=number_slider,
    TopPoint=move.Geometry,
    BasePolygonMethod=True,
    FillStrategy=1)
wbdodecahedron = WeaverbirdsPolylinesDodecahedron(Plane=PlaneXY(0, 0, 0), Radius=number_slider_2)
list = ValueList({"Dodecahedron": 0, "Icosahedron": 1, "Double Pyramid": 2, "Antiprism": 3}, selected="Dodecahedron")
mesh = MeshBrep(
    Brep=wbdodecahedron,
    Settings={GridMaxCount=0, GridMinCount=16, JaggedSeams=False, MaxEdgeLength=0, MinEdgeLength=0.0001, MinTolerance=0, Refine=True, RefineAngle=0, RelativeTolerance=0.65, SimplePlanes=True, Tolerance=0})
filter = StreamFilter(Gate=list, Stream0=mesh, Stream1=wbicosahedron, Stream2=wbdipyramid, Stream3=wbantiprism)
scale_factor = Slider(1.781, range=1..6.001)
scale = Scale(Geometry=filter, Center=Point(0, 0, 0), Factor=scale_factor)  # -> Geometry, Transform
wbthicken = WeaverbirdsMeshThicken(MeshCurves=scale.Geometry, Distance="-3", OffsetType=0)
faceb = FaceBoundaries(Mesh=wbthicken)
boundary = BoundarySurfaces(Edges=faceb)
item = ListItem(List=faceb, Index=0, Wrap=True)
pcen = PolygonCenter(Polyline=boundary)  # -> CenterV, CenterE, CenterA
panel = Panel("""0
1
2
3
4
5
6
7""")
item_2 = ListItem(List=pcen.CenterV, Index=panel, Wrap=True)
item_3 = ListItem(List=faceb, Index=panel, Wrap=True)
cp = ControlPoints(Curve=item_3)  # -> flatten(Points), Weights, Knots
series = Series(Start=1, Step=1, Count=10)
addition = Addition(A="0", B=series)
addition_2 = Addition(A="3", B=series)
dom = ConstructDomain(DomainStart=addition, DomainEnd=addition_2)
pl = ConstructPlane(Origin=item_2, XAxis=Vector(1, 0, 0), YAxis=Vector(0, 1, 0))
subset = SubList(List=cp.Points, Domain=dom, Wrap=True)  # -> List, Index
xy = XYPlane(Origin=Point(0, 0, 0))  # disabled
number_slider_3 = Slider(24.747, range=5..40)
number_slider_4 = Slider(12.408, range=10..60)
number_slider_5 = Slider(3, range=2..5)
polygon = Polygon(Plane=PlaneXY(0, 0, 0), Radius="8", Segments="3", FilletRadius=0)  # -> Polygon, Length; disabled
polygon_2 = Polygon(Plane=PlaneXY(0, 0, 0), Radius=number_slider_3, Segments="3", FilletRadius=0)  # -> Polygon, Length; disabled
Z_2 = UnitZ(Factor=number_slider_4)
Z_3 = UnitZ(Factor=number_slider_5)
extr = Extrude(Base=polygon.Polygon, Direction=Z_2)
cap = CapHoles(Brep=extr)
extr_2 = Extrude(Base=polygon_2.Polygon, Direction=Z_3)
cap_2 = CapHoles(Brep=extr_2)
addition_3 = Addition(A=number_slider_4, B=number_slider_5)
offset = Offset(Curve=polygon.Polygon, Distance="1.776", Plane=xy, Corners=1)
debrep = DeconstructBrep(Brep=cap)  # -> Faces, Edges, Vertices
Z_4 = UnitZ(Factor=addition_3)
move_2 = Move(Geometry=offset, Motion=Z_4)  # -> Geometry, Transform
item_4 = ListItem(List=debrep.Faces, Index=5, Wrap=True)
pcen_2 = PolygonCenter(Polyline=item_4)  # -> CenterV, CenterE, CenterA
debrep_2 = DeconstructBrep(Brep=move_2.Geometry)  # -> Faces, Edges, Vertices
pl_origin = PlaneOrigin(Base=xy, Origin=pcen_2.CenterV)
item_5 = ListItem(List=debrep_2.Vertices, Index=[1, 2, 3], Wrap=True)
item_6 = ListItem(List=debrep_2.Vertices, Index=1, Wrap=True)
item_7 = ListItem(List=debrep_2.Vertices, Index=2, Wrap=True)
neg = Negative(Value=addition_3)
polygon_3 = Polygon(Plane=pl_origin, Radius=number_slider_3, Segments="3", FilletRadius=0)  # -> Polygon, Length
ln = Line(StartPoint=item_7, EndPoint=item_6)
cyl = Cylinder(Base=item_5, Radius="1.5", Length=neg)
len = Length(Curve=ln)
extr_3 = Extrude(Base=polygon_3.Polygon, Direction=Z_3)
mgnets_centers_distance = Panel(len)
cap_3 = CapHoles(Brep=extr_3)
sdiff = SolidDifference(BrepsA=[cap_2, cap_3], BrepsB=cyl)
