# Grasshopper definition spaceships_parametric_pressfit RECOVERY.gh (Grasshopper 0.9.76)

number_slider = Slider(45.8, range=0..100)
vec = VectorXYZ(XComponent="200", YComponent=0, ZComponent=0)  # -> Vector, Length
kerf_or_tollerance = Slider(20, range=20..100)
main_height = Slider(20, range=20..100)
main_width = Slider(20, range=20..100)
thickness = Slider(20, range=20..100)
slot_lenght = Slider(20, range=20..100)
insert_height_n_1 = Slider(20, range=20..100)
insert_height_n_2 = Slider(20, range=20..100)
xz = XZPlane(Origin=vec.Vector)
line_of_simmetry = Line()
polygon = Polygon(Plane=xz, Radius=number_slider, Segments=6, FilletRadius=0)  # -> Polygon, Length
multiplication = Multiplication(A=number_slider, B="1.2")
debrep = DeconstructBrep(Brep=polygon.Polygon)  # -> Faces, Edges, Vertices
cir = Circle(Plane=xz, Radius=multiplication)
pl_origin = PlaneOrigin(Base=xz, Origin=debrep.Vertices)
points = PointList(Points=debrep.Vertices, Size=8)
cir_2 = Circle(Plane=pl_origin, Radius="1.5")
item = ListItem(List=debrep.Vertices, Index=[0, 3], Wrap=True)
item_2 = ListItem(List=debrep.Vertices, Index=[4, 2], Wrap=True)
item_3 = ListItem(List=debrep.Vertices, Index=[5, 1], Wrap=True)
split = SplitList(List=item, Index=1)  # -> ListA, ListB
split_2 = SplitList(List=item_2, Index=1)  # -> ListA, ListB
split_3 = SplitList(List=item_3, Index=1)  # -> ListA, ListB
ln = Line(StartPoint=split.ListA, EndPoint=split.ListB)
ln_2 = Line(StartPoint=split_2.ListA, EndPoint=split_2.ListB)
ln_3 = Line(StartPoint=split_3.ListA, EndPoint=split_3.ListB)
ccx = CurveCurve(CurveA=ln, CurveB=ln_2)  # -> Points, ParamsA, ParamsB
ccx_2 = CurveCurve(CurveA=ln, CurveB=ln_3)  # -> Points, ParamsA, ParamsB
dist = Distance(PointA=ccx.Points, PointB=ccx_2.Points)

number_slider_2 = Slider(0.442, range=0..0.5)
vec_2 = VectorXYZ(XComponent="-200", YComponent=0, ZComponent=0)  # -> Vector, Length
xz_2 = XZPlane(Origin=vec_2.Vector)
polygon_2 = Polygon(Plane=xz_2, Radius=Slider(8.625, range=0..30), Segments="3", FilletRadius=0)  # -> Polygon, Length
rotate = Rotate(Geometry=polygon_2.Polygon, Angle=1.570796327, Plane=xz_2)  # -> Geometry, Transform
debrep_2 = DeconstructBrep(Brep=rotate.Geometry)  # -> Faces, graft(Edges), Vertices
curvepoint = PointOnCurve(debrep_2.Edges, parameter=0.5)
item_4 = ListItem(List=debrep_2.Vertices, Index=0, Wrap=True)
rad = Radians(Degrees="60")
pl_origin_2 = PlaneOrigin(Base=xz_2, Origin=item_4)
rotate_2 = Rotate(Geometry=rotate.Geometry, Angle=rad, Plane=pl_origin_2)  # -> Geometry, Transform
debrep_3 = DeconstructBrep(Brep=rotate_2.Geometry)  # -> Faces, graft(Edges), Vertices
bang = ExplodeTree(Data=curvepoint)  # -> Branch0, Branch1, Branch2
item_5 = ListItem(List=debrep_3.Vertices, Index=1, Wrap=True)
curvepoint_2 = PointOnCurve(debrep_3.Edges, parameter=0.5)
arc = Arc3Pt(PointA=bang.Branch1, PointB=bang.Branch2, PointC=bang.Branch0)  # -> Arc, Plane, Radius
bang_2 = ExplodeTree(Data=curvepoint_2)  # -> _0000, _0001, _0002
arc_2 = Arc3Pt(PointA=bang_2._0000, PointB=bang_2._0001, PointC=bang_2._0002)  # -> Arc, Plane, Radius
vec2pt = Vector2Pt(PointA=item_4, PointB=item_5, Unitize=False)  # -> Vector, Length
arrlinear = LinearArray(Geometry=[arc.Arc, arc_2.Arc], Direction=vec2pt.Vector, Count=Slider(6, range=0..10))  # -> Geometry, Transform
arrcurve = CurveArray(Count=10)  # -> Geometry, Transform
join = JoinCurves(Curves=arrcurve.Geometry, Preserve=False)
join_2 = JoinCurves(Curves=arrlinear.Geometry, Preserve=False)
neg = Negative(Value=number_slider_2)
offset = Offset(Curve=join_2, Distance=[number_slider_2, neg], Plane=PlaneXY(0, 0, 0), Corners=1)  # disabled

division = Division(A=dist, B="2")

vec_3 = VectorXYZ(XComponent=Slider(26.5, range=0..50), YComponent="0", ZComponent="0")  # -> Vector, Length
line = Line(Line((0, 0, 0), (0, 0, 100)))
end = EndPoints(Curve=line)  # -> Start, End
ln_4 = Line(StartPoint=end.End, EndPoint=vec_3.Vector)
end_2 = EndPoints(Curve=ln_4)  # -> Start, End
rec_3pt = Rectangle3Pt(PointA=end_2.Start, PointB=end.Start, PointC=end_2.End)  # -> Rectangle, Length
mirror = Mirror(Geometry=rec_3pt.Rectangle, Plane=PlaneYZ(0, 0, 0))  # -> Geometry, Transform
runion = RegionUnion(Curves=[rec_3pt.Rectangle, mirror.Geometry])

lunghezza_slot = Slider(42.384, range=3..100)
spessore_del_materiale = Slider(5.05, range=0..20)
lunghezza_slot_2 = Slider(47.508, range=3..100)
vec_4 = VectorXYZ(XComponent=Slider(50, range=0..50), YComponent="0", ZComponent="0")  # -> Vector, Length
line_2 = Line(Line((0, 0, 0), (0, 0, 100)))
end_3 = EndPoints(Curve=line_2)  # -> Start, End
ln_5 = Line(StartPoint=end_3.End, EndPoint=vec_4.Vector)
division_2 = Division(A=lunghezza_slot, B="2")
division_3 = Division(A=spessore_del_materiale, B="2")
neg_2 = Negative(Value=spessore_del_materiale)
neg_3 = Negative(Value=lunghezza_slot_2)
xz_3 = XZPlane(Origin=Point(0, 0, 0))
xz_4 = XZPlane(Origin=Point(0, 0, 0))
end_4 = EndPoints(Curve=ln_5)  # -> Start, End
dom = ConstructDomain(DomainStart=0, DomainEnd=neg_2)
dom_2 = ConstructDomain(DomainStart=0, DomainEnd=division_2)
dom_3 = ConstructDomain(DomainStart=0, DomainEnd=neg_3)
dom_4 = ConstructDomain(DomainStart=0, DomainEnd=division_3)
pt = Point(end_3.Start)
pt_2 = Point(end_3.End)
pl_origin_3 = PlaneOrigin(Base=xz_3, Origin=pt)
pl_origin_4 = PlaneOrigin(Base=xz_4, Origin=pt_2)
rec_3pt_2 = Rectangle3Pt(PointA=end_4.Start, PointB=end_3.Start, PointC=end_4.End)  # -> Rectangle, Length
rectangle = Rectangle(Plane=pl_origin_3, XSize=dom_2, YSize=dom, Radius=0)  # -> Rectangle, Length
rectangle_2 = Rectangle(Plane=pl_origin_4, XSize=dom_4, YSize=dom_3, Radius=0)  # -> Rectangle, Length
mirror_2 = Mirror(Geometry=rectangle_2.Rectangle, Plane=PlaneYZ(0, 0, 0))  # -> Geometry, Transform
mirror_3 = Mirror(Geometry=rec_3pt_2.Rectangle, Plane=PlaneYZ(0, 0, 0))  # -> Geometry, Transform
mirror_4 = Mirror(Geometry=rectangle.Rectangle, Plane=PlaneYZ(0, 0, 0))  # -> Geometry, Transform
runion_2 = RegionUnion(Curves=[mirror_2.Geometry, rectangle_2.Rectangle])
runion_3 = RegionUnion(Curves=[rec_3pt_2.Rectangle, mirror_3.Geometry])
runion_4 = RegionUnion(Curves=[mirror_4.Geometry, rectangle.Rectangle])
runion_5 = RegionUnion(Curves=[runion_3, runion_4])
rdiff = RegionDifference(CurvesA=runion_5, CurvesB=runion_2)

lunghezza_slot_3 = Slider(41.53, range=3..100)
spessore_del_materiale_2 = Slider(5.05, range=0..20)
lunghezza_slot_4 = Slider(44.092, range=3..100)
vec_5 = VectorXYZ(XComponent=Slider(50, range=0..50), YComponent="0", ZComponent="0")  # -> Vector, Length
line_3 = Line(Line((0, 0, 0), (0, 0, 100)))
end_5 = EndPoints(Curve=line_3)  # -> Start, End
ln_6 = Line(StartPoint=end_5.End, EndPoint=vec_5.Vector)
division_4 = Division(A=lunghezza_slot_3, B="2")
neg_4 = Negative(Value=spessore_del_materiale_2)
division_5 = Division(A=spessore_del_materiale_2, B="2")
neg_5 = Negative(Value=spessore_del_materiale_2)
xz_5 = XZPlane(Origin=Point(0, 0, 0))
xz_6 = XZPlane(Origin=Point(0, 0, 0))
end_6 = EndPoints(Curve=ln_6)  # -> Start, End
dom_5 = ConstructDomain(DomainStart=0, DomainEnd=neg_5)
dom_6 = ConstructDomain(DomainStart=0, DomainEnd=division_4)
dom_7 = ConstructDomain(DomainStart=neg_4, DomainEnd=lunghezza_slot_4)
dom_8 = ConstructDomain(DomainStart=0, DomainEnd=division_5)
pt_3 = Point(end_5.Start)
pt_4 = Point(end_5.Start)
pl_origin_5 = PlaneOrigin(Base=xz_5, Origin=pt_3)
pl_origin_6 = PlaneOrigin(Base=xz_6, Origin=pt_4)
rec_3pt_3 = Rectangle3Pt(PointA=end_6.Start, PointB=end_5.Start, PointC=end_6.End)  # -> Rectangle, Length
rectangle_3 = Rectangle(Plane=pl_origin_5, XSize=dom_6, YSize=dom_5, Radius=0)  # -> Rectangle, Length
rectangle_4 = Rectangle(Plane=pl_origin_6, XSize=dom_8, YSize=dom_7, Radius=0)  # -> Rectangle, Length
mirror_5 = Mirror(Geometry=rectangle_4.Rectangle, Plane=PlaneYZ(0, 0, 0))  # -> Geometry, Transform
mirror_6 = Mirror(Geometry=rec_3pt_3.Rectangle, Plane=PlaneYZ(0, 0, 0))  # -> Geometry, Transform
mirror_7 = Mirror(Geometry=rectangle_3.Rectangle, Plane=PlaneYZ(0, 0, 0))  # -> Geometry, Transform
runion_6 = RegionUnion(Curves=[mirror_5.Geometry, rectangle_4.Rectangle])
runion_7 = RegionUnion(Curves=[rec_3pt_3.Rectangle, mirror_6.Geometry])
runion_8 = RegionUnion(Curves=[mirror_7.Geometry, rectangle_3.Rectangle])
runion_9 = RegionUnion(Curves=[runion_7, runion_8])
rdiff_2 = RegionDifference(CurvesA=runion_9, CurvesB=runion_6)

spessore_del_materiale_3 = Slider(5.11, range=0..20)
lunghezza_slot_5 = Slider(30.431, range=3..100)
lunghezza_slot_6 = Slider(26.452, range=3..100)
number_slider_3 = Slider(50, range=0..50)

spessore_del_materiale_4 = Slider(-4.64, range=-20..0)
lunghezza_slot_7 = Slider(34.549, range=3..100)
xz_7 = XZPlane(Origin=Point(0, 0, 0))
dom_9 = ConstructDomain(DomainStart=0, DomainEnd=spessore_del_materiale_4)
dom_10 = ConstructDomain(DomainStart=0, DomainEnd=lunghezza_slot_7)
pt_5 = Point(Point(-100, 0, 0))
pl_origin_7 = PlaneOrigin(Base=xz_7, Origin=pt_5)
rectangle_5 = Rectangle(Plane=pl_origin_7, XSize=dom_10, YSize=dom_9, Radius=0)  # -> Rectangle, Length

vec_6 = VectorXYZ(XComponent=number_slider_3, YComponent="0", ZComponent="0")  # -> Vector, Length
line_4 = Line(Line((0, 0, 0), (0, 0, 100)))
X = UnitX(Factor=division)
end_7 = EndPoints(Curve=line_4)  # -> Start, End
move = Move(Geometry=line_4, Motion=X)  # -> Geometry, Transform
ln_7 = Line(StartPoint=end_7.End, EndPoint=vec_6.Vector)
neg_6 = Negative(Value=spessore_del_materiale_3)
division_6 = Division(A=spessore_del_materiale_3, B="2")
neg_7 = Negative(Value=spessore_del_materiale_3)
division_7 = Division(A=spessore_del_materiale_3, B="2")
neg_8 = Negative(Value=lunghezza_slot_6)
end_8 = EndPoints(Curve=move.Geometry)  # -> Start, End
xz_8 = XZPlane(Origin=Point(0, 0, 0))
xz_9 = XZPlane(Origin=Point(0, 0, 0))
end_9 = EndPoints(Curve=ln_7)  # -> Start, End
dom_11 = ConstructDomain(DomainStart=0, DomainEnd=neg_7)
dom_12 = ConstructDomain(DomainStart=0, DomainEnd=number_slider_3)
dom_13 = ConstructDomain(DomainStart=neg_6, DomainEnd=lunghezza_slot_5)
dom_14 = ConstructDomain(DomainStart=0, DomainEnd=division_6)
xz_10 = XZPlane(Origin=end_8.End)
dom_15 = ConstructDomain(DomainStart=0, DomainEnd=neg_8)
dom_16 = ConstructDomain(DomainStart=0, DomainEnd=division_7)
pt_6 = Point(end_7.Start)
pt_7 = Point(end_7.Start)
pt_8 = Point(end_8.End)
pl_origin_8 = PlaneOrigin(Base=xz_8, Origin=pt_6)
pl_origin_9 = PlaneOrigin(Base=xz_9, Origin=pt_7)
pl_origin_10 = PlaneOrigin(Base=xz_10, Origin=pt_8)
rec_3pt_4 = Rectangle3Pt(PointA=end_9.Start, PointB=end_7.Start, PointC=end_9.End)  # -> Rectangle, Length
rectangle_6 = Rectangle(Plane=pl_origin_8, XSize=dom_12, YSize=dom_11, Radius=0)  # -> Rectangle, Length
rectangle_7 = Rectangle(Plane=pl_origin_9, XSize=dom_14, YSize=dom_13, Radius=0)  # -> Rectangle, Length
rectangle_8 = Rectangle(Plane=pl_origin_10, XSize=dom_16, YSize=dom_15, Radius=0)  # -> Rectangle, Length
yz = YZPlane(Origin=Point(0, 0, 0))
pl_origin_11 = PlaneOrigin(Base=yz, Origin=pt_8)
mirror_8 = Mirror(Geometry=rec_3pt_4.Rectangle, Plane=PlaneYZ(0, 0, 0))  # -> Geometry, Transform
mirror_9 = Mirror(Geometry=rectangle_6.Rectangle, Plane=PlaneYZ(0, 0, 0))  # -> Geometry, Transform
mirror_10 = Mirror(Geometry=rectangle_7.Rectangle, Plane=PlaneYZ(0, 0, 0))  # -> Geometry, Transform
mirror_11 = Mirror(Geometry=rectangle_8.Rectangle, Plane=pl_origin_11)  # -> Geometry, Transform
runion_10 = RegionUnion(Curves=[rec_3pt_4.Rectangle, mirror_8.Geometry])
runion_11 = RegionUnion(Curves=[mirror_9.Geometry, rectangle_6.Rectangle])
runion_12 = RegionUnion(Curves=[runion_10, runion_11])
runion_13 = RegionUnion(Curves=[mirror_10.Geometry, rectangle_7.Rectangle])
runion_14 = RegionUnion(Curves=[mirror_11.Geometry, rectangle_8.Rectangle])
mirror_12 = Mirror(Geometry=runion_14, Plane=PlaneYZ(0, 0, 0))  # -> Geometry, Transform
rdiff_3 = RegionDifference(CurvesA=runion_12, CurvesB=[runion_13, runion_14, mirror_12.Geometry])
