# Grasshopper definition spaceships_parametric_pressfit.gh (Grasshopper 0.9.76)

oriz_ref_1 = Slider(41.356, range=3..100)
oriz_ref_2 = Slider(45.285, range=3..100)
material_thickness = Slider(6.7, range=0..20)
slot_lenght = Slider(20, range=3..20)

kerf_or_tollerance = Slider(0.1, range=0..0.3)
list = ValueList({"Material 1": 1, "Material 2": 1.1, "Material 3": 1.2, "Material 4": 1.3, "Material 5": 1.4, "Material 6": 1.5}, selected="Material 1")

half_width = Slider(50, range=0..50)

base_radius = Slider(1.25, range=1.15..1.5)
magnets_radius = Panel("1.5")
list_2 = ValueList({"pz 1": 0, "pz 2": 1, "pz 3": 2, "pz 4": 3, "circular base": 4, "ALL NESTED": 5}, selected="ALL NESTED")
xz = XZPlane(Origin=Point(0, 0, 0))
line = Line(Line((0, 0, 0), (0, 0, 100)))
number_slider = Slider(45.8, range=0..100)
vec = VectorXYZ(XComponent=0, YComponent=0, ZComponent="-70")  # -> Vector, Length
xz_2 = XZPlane(Origin=vec.Vector)
subtraction = Subtraction(A=half_width, B="10")
polygon = Polygon(Plane=xz_2, Radius=subtraction, Segments=6, FilletRadius=0)  # -> Polygon, Length
debrep = DeconstructBrep(Brep=polygon.Polygon)  # -> Faces, Edges, Vertices
points = PointList(Points=debrep.Vertices, Size=8)
item = ListItem(List=debrep.Vertices, Index=[0, 3], Wrap=True)
item_2 = ListItem(List=debrep.Vertices, Index=[4, 2], Wrap=True)
item_3 = ListItem(List=debrep.Vertices, Index=[5, 1], Wrap=True)
split = SplitList(List=item, Index=1)  # -> ListA, ListB
split_2 = SplitList(List=item_2, Index=1)  # -> ListA, ListB
split_3 = SplitList(List=item_3, Index=1)  # -> ListA, ListB
ln = Line(StartPoint=split.ListA, EndPoint=split.ListB)
ln_2 = Line(StartPoint=split_2.ListA, EndPoint=split_2.ListB)
ln_3 = Line(StartPoint=split_3.ListA, EndPoint=split_3.ListB)
ccx = CurveCurve(CurveA=ln, CurveB=ln_2)  # -> Points, ParamsA, ParamsB
ccx_2 = CurveCurve(CurveA=ln, CurveB=ln_3)  # -> Points, ParamsA, ParamsB
vec_2 = VectorXYZ(XComponent=half_width, YComponent="0", ZComponent="0")  # -> Vector, Length
vec_3 = VectorXYZ(XComponent=half_width, YComponent="0", ZComponent="0")  # -> Vector, Length
dist = Distance(PointA=ccx.Points, PointB=ccx_2.Points)
vec_4 = VectorXYZ(XComponent=half_width, YComponent="0", ZComponent="0")  # -> Vector, Length
curvepoint = PointOnCurve(ln, parameter=0.5)
subtraction_2 = Subtraction(A="100", B=oriz_ref_2)
division = Division(A=dist, B="2")
X = UnitX(Factor=division)
subtraction_3 = Subtraction(A="100", B=oriz_ref_1)
end = EndPoints(Curve=line)  # -> Start, End
end_2 = EndPoints(Curve=line)  # -> Start, End
vec_5 = VectorXYZ(XComponent=half_width, YComponent="0", ZComponent="0")  # -> Vector, Length
end_3 = EndPoints(Curve=line)  # -> Start, End
move = Move(Geometry=line, Motion=X)  # -> Geometry, Transform
ln_4 = Line(StartPoint=end.End, EndPoint=vec_2.Vector)
ln_5 = Line(StartPoint=end_2.End, EndPoint=vec_3.Vector)
division_2 = Division(A=slot_lenght, B="2")
division_3 = Division(A=slot_lenght, B="2")
neg = Negative(Value=material_thickness)
division_4 = Division(A=material_thickness, B="2")
neg_2 = Negative(Value=material_thickness)
neg_3 = Negative(Value=material_thickness)
neg_4 = Negative(Value=subtraction_3)
division_5 = Division(A=material_thickness, B="2")
ln_6 = Line(StartPoint=end_3.End, EndPoint=vec_4.Vector)
division_6 = Division(A=slot_lenght, B="2")
neg_5 = Negative(Value=material_thickness)
division_7 = Division(A=material_thickness, B="2")
neg_6 = Negative(Value=material_thickness)
division_8 = Division(A=material_thickness, B="2")
neg_7 = Negative(Value=oriz_ref_2)
end_4 = EndPoints(Curve=move.Geometry)  # -> Start, End
end_5 = EndPoints(Curve=line)  # -> Start, End
dom = ConstructDomain(DomainStart=0, DomainEnd=material_thickness)
dom_2 = ConstructDomain(DomainStart=0, DomainEnd=slot_lenght)
end_6 = EndPoints(Curve=ln_4)  # -> Start, End
end_7 = EndPoints(Curve=ln_5)  # -> Start, End
dom_3 = ConstructDomain(DomainStart=0, DomainEnd=neg_2)
dom_4 = ConstructDomain(DomainStart=0, DomainEnd=division_2)
dom_5 = ConstructDomain(DomainStart=0, DomainEnd=neg_4)
dom_6 = ConstructDomain(DomainStart=0, DomainEnd=division_4)
dom_7 = ConstructDomain(DomainStart=0, DomainEnd=neg_3)
dom_8 = ConstructDomain(DomainStart=0, DomainEnd=division_3)
dom_9 = ConstructDomain(DomainStart=neg, DomainEnd=subtraction_2)
dom_10 = ConstructDomain(DomainStart=0, DomainEnd=division_5)
pt = Point(end.Start)
pt_2 = Point(end.End)
pt_3 = Point(end_2.Start)
pt_4 = Point(end_2.Start)
end_8 = EndPoints(Curve=ln_6)  # -> Start, End
dom_11 = ConstructDomain(DomainStart=0, DomainEnd=neg_6)
dom_12 = ConstructDomain(DomainStart=0, DomainEnd=division_6)
dom_13 = ConstructDomain(DomainStart=neg_5, DomainEnd=oriz_ref_1)
dom_14 = ConstructDomain(DomainStart=0, DomainEnd=division_7)
dom_15 = ConstructDomain(DomainStart=0, DomainEnd=neg_7)
dom_16 = ConstructDomain(DomainStart=0, DomainEnd=division_8)
xz_3 = XZPlane(Origin=end_4.End)
pt_5 = Point(end_3.Start)
pt_6 = Point(end_3.Start)
ln_7 = Line(StartPoint=end_5.End, EndPoint=vec_5.Vector)
pt_7 = Point(end_4.End)
pt_8 = Point(Point(-100, 0, 0))
division_9 = Division(A=material_thickness, B="2")
pl_origin = PlaneOrigin(Base=xz, Origin=pt)
pl_origin_2 = PlaneOrigin(Base=xz, Origin=pt_3)
division_10 = Division(A=slot_lenght, B="2")
pl_origin_3 = PlaneOrigin(Base=xz, Origin=pt_2)
pl_origin_4 = PlaneOrigin(Base=xz, Origin=pt_4)
pl_origin_5 = PlaneOrigin(Base=xz, Origin=pt_5)
pl_origin_6 = PlaneOrigin(Base=xz, Origin=pt_6)
pl_origin_7 = PlaneOrigin(Base=xz_3, Origin=pt_7)
end_9 = EndPoints(Curve=ln_7)  # -> Start, End
pl_origin_8 = PlaneOrigin(Base=xz, Origin=pt_8)
Z = UnitZ(Factor=division_9)
X_2 = UnitX(Factor=division_10)
rec_3pt = Rectangle3Pt(PointA=end_6.Start, PointB=end.Start, PointC=end_6.End)  # -> Rectangle, Length
rectangle = Rectangle(Plane=pl_origin, XSize=dom_4, YSize=dom_3, Radius=0)  # -> Rectangle, Length
rectangle_2 = Rectangle(Plane=pl_origin_3, XSize=dom_6, YSize=dom_5, Radius=0)  # -> Rectangle, Length
rec_3pt_2 = Rectangle3Pt(PointA=end_7.Start, PointB=end_2.Start, PointC=end_7.End)  # -> Rectangle, Length
rectangle_3 = Rectangle(Plane=pl_origin_2, XSize=dom_8, YSize=dom_7, Radius=0)  # -> Rectangle, Length
rectangle_4 = Rectangle(Plane=pl_origin_4, XSize=dom_10, YSize=dom_9, Radius=0)  # -> Rectangle, Length
rec_3pt_3 = Rectangle3Pt(PointA=end_8.Start, PointB=end_3.Start, PointC=end_8.End)  # -> Rectangle, Length
rectangle_5 = Rectangle(Plane=pl_origin_5, XSize=dom_12, YSize=dom_11, Radius=0)  # -> Rectangle, Length
rectangle_6 = Rectangle(Plane=pl_origin_6, XSize=dom_14, YSize=dom_13, Radius=0)  # -> Rectangle, Length
rectangle_7 = Rectangle(Plane=pl_origin_7, XSize=dom_16, YSize=dom_15, Radius=0)  # -> Rectangle, Length
move_2 = Move(Geometry=curvepoint, Motion=Z)  # -> Geometry, Transform
move_3 = Move(Geometry=curvepoint, Motion=X_2)  # -> Geometry, Transform
rectangle_8 = Rectangle(Plane=pl_origin_8, XSize=dom_2, YSize=dom, Radius=0)  # -> Rectangle, Length
rec_3pt_4 = Rectangle3Pt(PointA=end_9.Start, PointB=end_5.Start, PointC=end_9.End)  # -> Rectangle, Length
mirror = Mirror(Geometry=rec_3pt_4.Rectangle, Plane=PlaneYZ(0, 0, 0))  # -> Geometry, Transform
mirror_2 = Mirror(Geometry=rectangle_2.Rectangle, Plane=PlaneYZ(0, 0, 0))  # -> Geometry, Transform
mirror_3 = Mirror(Geometry=rectangle_4.Rectangle, Plane=PlaneYZ(0, 0, 0))  # -> Geometry, Transform
yz = YZPlane(Origin=Point(0, 0, 0))
mirror_4 = Mirror(Geometry=rec_3pt.Rectangle, Plane=PlaneYZ(0, 0, 0))  # -> Geometry, Transform
mirror_5 = Mirror(Geometry=rec_3pt_2.Rectangle, Plane=PlaneYZ(0, 0, 0))  # -> Geometry, Transform
mirror_6 = Mirror(Geometry=rectangle.Rectangle, Plane=PlaneYZ(0, 0, 0))  # -> Geometry, Transform
mirror_7 = Mirror(Geometry=rectangle_3.Rectangle, Plane=PlaneYZ(0, 0, 0))  # -> Geometry, Transform
pl_origin_9 = PlaneOrigin(Base=yz, Origin=pt_7)
rec_3pt_5 = Rectangle3Pt(PointA=curvepoint, PointB=move_2.Geometry, PointC=move_3.Geometry)  # -> Rectangle, Length
runion = RegionUnion(Curves=[rec_3pt_4.Rectangle, mirror.Geometry])
runion_2 = RegionUnion(Curves=[mirror_2.Geometry, rectangle_2.Rectangle])
runion_3 = RegionUnion(Curves=[mirror_3.Geometry, rectangle_4.Rectangle])
runion_4 = RegionUnion(Curves=[rec_3pt.Rectangle, mirror_4.Geometry])
runion_5 = RegionUnion(Curves=[rec_3pt_2.Rectangle, mirror_5.Geometry])
runion_6 = RegionUnion(Curves=[mirror_6.Geometry, rectangle.Rectangle])
runion_7 = RegionUnion(Curves=[mirror_7.Geometry, rectangle_3.Rectangle])
xy = XYPlane(Origin=Point(0, 0, 0))
mirror_8 = Mirror(Geometry=rec_3pt_3.Rectangle, Plane=PlaneYZ(0, 0, 0))  # -> Geometry, Transform
mirror_9 = Mirror(Geometry=rectangle_5.Rectangle, Plane=PlaneYZ(0, 0, 0))  # -> Geometry, Transform
mirror_10 = Mirror(Geometry=rectangle_6.Rectangle, Plane=PlaneYZ(0, 0, 0))  # -> Geometry, Transform
mirror_11 = Mirror(Geometry=rectangle_7.Rectangle, Plane=pl_origin_9)  # -> Geometry, Transform
mirror_12 = Mirror(Geometry=rec_3pt_5.Rectangle, Plane=PlaneYZ(0, 0, 0))  # -> Geometry, Transform
pl_origin_10 = PlaneOrigin(Base=xy, Origin=curvepoint)
mirror_13 = Mirror(Geometry=pl_origin_9, Plane=PlaneYZ(0, 0, 0))  # -> Geometry, Transform
mirror_14 = Mirror(Geometry=[mirror_12.Geometry, rec_3pt_5.Rectangle], Plane=pl_origin_10)  # -> Geometry, Transform
runion_8 = RegionUnion(Curves=[rec_3pt_3.Rectangle, mirror_8.Geometry])
runion_9 = RegionUnion(Curves=[mirror_9.Geometry, rectangle_5.Rectangle])
runion_10 = RegionUnion(Curves=[rec_3pt_5.Rectangle, mirror_12.Geometry, mirror_14.Geometry])
rad = Radians(Degrees=90)
runion_11 = RegionUnion(Curves=[mirror_10.Geometry, rectangle_6.Rectangle])
runion_12 = RegionUnion(Curves=[mirror_11.Geometry, rectangle_7.Rectangle])
vec2pt = Vector2Pt(PointA=curvepoint, PointB=ccx.Points, Unitize=False)  # -> Vector, Length
vec2pt_2 = Vector2Pt(PointA=curvepoint, PointB=ccx_2.Points, Unitize=False)  # -> Vector, Length
rotate = Rotate(Geometry=runion_10, Angle=rad, Plane=xz_2)  # -> Geometry, Transform

number_slider_2 = Slider(0.442, range=0..0.5)
vec_6 = VectorXYZ(XComponent="-200", YComponent=0, ZComponent=0)  # -> Vector, Length
xz_4 = XZPlane(Origin=vec_6.Vector)
polygon_2 = Polygon(Plane=xz_4, Radius=Slider(7.519, range=0..30), Segments="3", FilletRadius=0)  # -> Polygon, Length
rotate_2 = Rotate(Geometry=polygon_2.Polygon, Angle=1.570796327, Plane=xz_4)  # -> Geometry, Transform
debrep_2 = DeconstructBrep(Brep=rotate_2.Geometry)  # -> Faces, graft(Edges), Vertices
item_4 = ListItem(List=debrep_2.Vertices, Index=0, Wrap=True)
curvepoint_2 = PointOnCurve(debrep_2.Edges, parameter=0.5)
rad_2 = Radians(Degrees="60")
pl_origin_11 = PlaneOrigin(Base=xz_4, Origin=item_4)
rotate_3 = Rotate(Geometry=rotate_2.Geometry, Angle=rad_2, Plane=pl_origin_11)  # -> Geometry, Transform
debrep_3 = DeconstructBrep(Brep=rotate_3.Geometry)  # -> Faces, graft(Edges), Vertices
bang = ExplodeTree(Data=curvepoint_2)  # -> Branch0, Branch1, Branch2
item_5 = ListItem(List=debrep_3.Vertices, Index=1, Wrap=True)
curvepoint_3 = PointOnCurve(debrep_3.Edges, parameter=0.5)
arc = Arc3Pt(PointA=bang.Branch1, PointB=bang.Branch2, PointC=bang.Branch0)  # -> Arc, Plane, Radius
bang_2 = ExplodeTree(Data=curvepoint_3)  # -> _0000, _0001, _0002
arc_2 = Arc3Pt(PointA=bang_2._0000, PointB=bang_2._0001, PointC=bang_2._0002)  # -> Arc, Plane, Radius
vec2pt_3 = Vector2Pt(PointA=item_4, PointB=item_5, Unitize=False)  # -> Vector, Length
arrlinear = LinearArray(Geometry=[arc.Arc, arc_2.Arc], Direction=vec2pt_3.Vector, Count=Slider(10, range=0..10))  # -> Geometry, Transform
arrcurve = CurveArray(Count=10)  # -> Geometry, Transform
join = JoinCurves(Curves=arrcurve.Geometry, Preserve=False)
join_2 = JoinCurves(Curves=arrlinear.Geometry, Preserve=False)
neg_8 = Negative(Value=number_slider_2)
offset = Offset(Curve=join_2, Distance=[number_slider_2, neg_8], Plane=PlaneXY(0, 0, 0), Corners=1)  # disabled

mirror_15 = Mirror(Geometry=runion_12, Plane=PlaneYZ(0, 0, 0))  # -> Geometry, Transform
pl_origin_12 = PlaneOrigin(Base=xz_2, Origin=debrep.Vertices)
cir = Circle(Plane=pl_origin_12, Radius=magnets_radius)
runion_13 = RegionUnion(Curves=[runion_10, rotate.Geometry])
move_4 = Move(Geometry=runion_13, Motion=vec2pt.Vector)  # -> Geometry, Transform
move_5 = Move(Geometry=runion_13, Motion=vec2pt_2.Vector)  # -> Geometry, Transform

subtraction_4 = Subtraction(A=slot_lenght, B=kerf_or_tollerance)  # disabled
division_11 = Division(A=subtraction_4, B=slot_lenght)
multiplication = Multiplication(A=division_11, B=list)
slot = Curve(runion_6)
pin = Curve(runion_2)
neg_9 = Negative(Value=multiplication)
scale_nu = ScaleNU(Geometry=slot, Plane=xz, ScaleX=multiplication, ScaleY=1, ScaleZ=1)  # -> Geometry, Transform
scale_nu_2 = ScaleNU(Geometry=pin, Plane=xz, ScaleX=neg_9, ScaleY=1, ScaleZ=1)  # -> Geometry, Transform

subtraction_5 = Subtraction(A=slot_lenght, B=kerf_or_tollerance)  # disabled
division_12 = Division(A=subtraction_5, B=slot_lenght)
multiplication_2 = Multiplication(A=division_12, B=list)
slot_2 = Curve(runion_7)
pin_2 = Curve(runion_3)
neg_10 = Negative(Value=multiplication_2)
scale_nu_3 = ScaleNU(Geometry=slot_2, Plane=xz, ScaleX=multiplication_2, ScaleY=1, ScaleZ=1)  # -> Geometry, Transform
scale_nu_4 = ScaleNU(Geometry=pin_2, Plane=xz, ScaleX=neg_10, ScaleY=1, ScaleZ=1)  # -> Geometry, Transform

subtraction_6 = Subtraction(A=slot_lenght, B=kerf_or_tollerance)  # disabled
division_13 = Division(A=subtraction_6, B=slot_lenght)
multiplication_3 = Multiplication(A=division_13, B=list)
slot_3 = Curve(runion_9)
pin_3 = Curve(runion_11)
pin_4 = Curve(mirror_15.Geometry)
pin_5 = Curve(runion_12)
neg_11 = Negative(Value=multiplication_3)
neg_12 = Negative(Value=multiplication_3)
neg_13 = Negative(Value=multiplication_3)
scale_nu_5 = ScaleNU(Geometry=slot_3, Plane=xz, ScaleX=multiplication_3, ScaleY=1, ScaleZ=1)  # -> Geometry, Transform
scale_nu_6 = ScaleNU(Geometry=pin_3, Plane=xz, ScaleX=neg_11, ScaleY=1, ScaleZ=1)  # -> Geometry, Transform
scale_nu_7 = ScaleNU(Geometry=pin_4, Plane=mirror_13.Geometry, ScaleX=neg_12, ScaleY=1, ScaleZ=1)  # -> Geometry, Transform
scale_nu_8 = ScaleNU(Geometry=pin_5, Plane=pl_origin_9, ScaleX=neg_13, ScaleY=1, ScaleZ=1)  # -> Geometry, Transform

multiplication_4 = Multiplication(A=kerf_or_tollerance, B=list)
multiplication_5 = Multiplication(A=subtraction, B=base_radius)
offset_2 = Offset(Curve=[cir, runion_13, move_4.Geometry, move_5.Geometry], Distance=multiplication_4, Plane=PlaneXY(0, 0, 0), Corners=1)
cir_2 = Circle(Plane=xz_2, Radius=multiplication_5)
runion_14 = RegionUnion(Curves=[runion_4, runion_6])
runion_15 = RegionUnion(Curves=[runion_5, runion_7])
runion_16 = RegionUnion(Curves=[runion_8, runion_9])
rdiff = RegionDifference(CurvesA=runion_14, CurvesB=runion_2)
rdiff_2 = RegionDifference(CurvesA=runion_15, CurvesB=runion_3)
rdiff_3 = RegionDifference(CurvesA=runion_16, CurvesB=[runion_11, runion_12, mirror_15.Geometry])
X_3 = UnitX(Factor="210")
X_4 = UnitX(Factor="0")
X_5 = UnitX(Factor="105")
X_6 = UnitX(Factor="315")
move_6 = Move(Geometry=rdiff_2, Motion=X_3)  # -> Geometry, Transform
move_7 = Move(Geometry=rdiff, Motion=X_4)  # -> Geometry, Transform
move_8 = Move(Geometry=rdiff_2, Motion=X_5)  # -> Geometry, Transform
move_9 = Move(Geometry=rdiff_3, Motion=X_6)  # -> Geometry, Transform
group = Group(Objects=[cir_2, offset_2])
filter = StreamFilter(
    Gate=list_2,
    Stream0=rdiff,
    Stream1=rdiff_2,
    Stream2=rdiff_2,
    Stream3=rdiff_3,
    Stream4=group,
    Stream5=[move_7.Geometry, move_8.Geometry, move_6.Geometry, move_9.Geometry, group])
