# Grasshopper definition bending_kerf_generator.gh (Grasshopper 0.9.76)

number_of_kerfs = Slider(27, range=1..100)
c_separator_width = Slider(5.57, range=1..20)
stock_thickness = Slider(10.563, range=0..50)
stock_lenght = Slider(161, range=0..1000)
kerf_width = Slider(3.874, range=0.5..20)
kerf_depth = Slider(22.415, range=0..50)
cluster = Cluster(
    B_2=stock_lenght,
    B=stock_thickness,
    A_2=stock_thickness,
    A=kerf_width,
    A_4=kerf_width,
    A_3=c_separator_width,
    A_6=kerf_depth,
    A_5=stock_thickness,
    N=c_separator_width,
    C=number_of_kerfs)  # -> R, R_2, R_3, G
d_b_bottom_thickness = Panel(cluster.R_2)
cluster_2 = Cluster_2(L=cluster.R_3, A=number_of_kerfs)
max_theoretical_bendable_angle = Panel(cluster_2)
pattern = RegionDifference(CurvesA=cluster.R, CurvesB=cluster.G)

# ==== cluster Cluster
B = ClusterInput()
B_2 = ClusterInput()
N = ClusterInput()
C = ClusterInput()
A = ClusterInput()
A_2 = ClusterInput()
A_3 = ClusterInput()
A_4 = ClusterInput()
A_5 = ClusterInput()
A_6 = ClusterInput()

# ---- group: PATTERN DRAWING / KERF WIDT
subtraction = Subtraction(A=A_3, B="1")
min = Minimum(A=A_4, B=subtraction)
dom = ConstructDomain(DomainStart="0.5", DomainEnd=min)
subtraction_2 = Subtraction(A=A, B="0.5")
panel = Panel(subtraction_2)

# ---- group: PATTERN DRAWING
dom_2 = ConstructDomain(DomainStart="0", DomainEnd=B_2)

subtraction_3 = Subtraction(A=A_5, B="1")
min_2 = Minimum(A=A_6, B=subtraction_3)
series = Series(Start=1, Step=N, Count=C)
dom_3 = ConstructDomain(DomainStart="0", DomainEnd=B)
X = UnitX(Factor=series)
subtraction_4 = Subtraction(A=A_2, B=min_2)
rectangle = Rectangle(Plane=PlaneXY(0, 0, 0), XSize=dom_2, YSize=dom_3, Radius=0)  # -> Rectangle, Length

# ----
R = ClusterOutput(rectangle.Rectangle)
R_2 = ClusterOutput(subtraction_4)

# ---- group: PATTERN DRAWING / KERF DEPTH
kerf_depth = ConstructDomain(DomainStart="0", DomainEnd=min_2)

# ---- group: PATTERN DRAWING (continued)
rectangle_2 = Rectangle(Plane=PlaneXY(0, 0, 0), XSize=dom, YSize=kerf_depth, Radius=0)  # -> Rectangle, Length
move = Move(Geometry=rectangle_2.Rectangle, Motion=X)  # -> Geometry, Transform

# ----
R_3 = ClusterOutput(rectangle_2.Rectangle)
G = ClusterOutput(move.Geometry)

# ==== cluster Cluster_2
L = ClusterInput()
A = ClusterInput()

# ---- group: ANGLE CALCULATION
item = ListItem(List=L, Index=0, Wrap=True)
debrep = DeconstructBrep(Brep=item)  # -> Faces, Edges, Vertices
item_2 = ListItem(List=debrep.Edges, Index=2, Wrap=True)
item_3 = ListItem(List=debrep.Vertices, Index=0, Wrap=True)
curvepoint = PointOnCurve(item_2, parameter=0.5)
ln = Line(StartPoint=curvepoint, EndPoint=item_3)
item_4 = ListItem(List=debrep.Edges, Index=1, Wrap=True)
angle = Angle(VectorA=ln, VectorB=item_4)  # -> Angle, Reflex
deg = Degrees(Radians=angle.Angle)
multiplication = Multiplication(A=deg, B=2)
multiplication_2 = Multiplication(A=A, B=multiplication)

# ----
R = ClusterOutput(multiplication_2)
