# Grasshopper definition cut_generator.gh (Grasshopper 0.9.76)

rec = Rectangle({Plane=PlaneXY(-65.5015565, 45.16160422, 7.958129009), Size=Domain2(u=0..33.60458915, v=0..29.10240422)})
crv = Curve(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)
pop2d = Populate2D(Region=rec, Count=100, Seed=1)
curvepoint = PointOnCurve(crv, parameter=0.881)
len = Length(Curve=crv)
voronoi = Voronoi(Points=pop2d, Boundary=rec, BruteForceOverride=False)
dist = Distance(PointA=pop2d, PointB=curvepoint)
dom = ConstructDomain(DomainStart=0, DomainEnd=len)
dom_2 = ConstructDomain(DomainStart=Slider(-1.287, range=-3..0), DomainEnd=Slider(0, range=-10..0))
remap = RemapNumbers(Value=dist, Source=dom, Target=dom_2)  # -> Mapped, Clipped
offset = Offset(Curve=voronoi, Distance=remap.Mapped, Plane=PlaneXY(0, 0, 0), Corners=1)
Z = UnitZ(Factor=1)
brep = Brep(<brep referenced from the Rhino model>)
neg = Negative(Value=Z)
project = Project(Curve=offset, Brep=brep, Direction=neg)
